# Grasshopper definition burger_compute.gh (Grasshopper 1.0.7)

floors = Slider(2, range=1..10)
meet_height = Slider(350, range=0..1000)
cheese_height = Slider(55, range=0..1000)
cheese = Geometry(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)
lettuce = Geometry(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)
meat = Geometry(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)
mustard = Geometry(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)
ketchup = Geometry(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)
onion = Geometry(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)
tomato = Geometry(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)
top_bread = Geometry(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)
lettuce_2 = GetBoolean(Toggle(True), AtLeast=1, AtMost=1, FalseValue="False", TreeAccess=False, TrueValue="True")
cheese_2 = GetBoolean(Toggle(True), AtLeast=1, AtMost=1, FalseValue="False", TreeAccess=False, TrueValue="True")
mustard_2 = GetBoolean(Toggle(True), AtLeast=1, AtMost=1, FalseValue="False", TreeAccess=False, TrueValue="True")
tomato_2 = GetBoolean(Toggle(True), AtLeast=1, AtMost=1, FalseValue="False", TreeAccess=False, TrueValue="True")
onion_2 = GetBoolean(Toggle(True), AtLeast=1, AtMost=1, FalseValue="False", TreeAccess=False, TrueValue="True")
ketchup_2 = GetBoolean(Toggle(True), AtLeast=1, AtMost=1, FalseValue="False", TreeAccess=False, TrueValue="True")
c_script = CSharpScript(geometry=meat, userKey="part", userValue="meat")  # -> out, geo; inputs geometry: GeometryBase, userKey: String, userValue: String
# ---------- c_script: C# ----------
    if(geometry != null)
    {geometry.SetUserString(userKey, userValue);
      geo = geometry;
    }else return;
# ---------- end c_script ----------
c_script_2 = CSharpScript(geometry=cheese, userKey="part", userValue="cheese")  # -> out, geo; inputs geometry: GeometryBase, userKey: String, userValue: String; same code as c_script
c_script_3 = CSharpScript(geometry=lettuce, userKey="part", userValue="lettuce")  # -> out, geo; inputs geometry: GeometryBase, userKey: String, userValue: String; same code as c_script
c_script_4 = CSharpScript(geometry=mustard, userKey="part", userValue="mustard")  # -> out, geo; inputs geometry: GeometryBase, userKey: String, userValue: String; same code as c_script
c_script_5 = CSharpScript(geometry=onion, userKey="part", userValue="onion")  # -> out, geo; inputs geometry: GeometryBase, userKey: String, userValue: String; same code as c_script
c_script_6 = CSharpScript(geometry=ketchup, userKey="part", userValue="ketchup")  # -> out, geo; inputs geometry: GeometryBase, userKey: String, userValue: String; same code as c_script
c_script_7 = CSharpScript(geometry=tomato, userKey="part", userValue="tomato")  # -> out, geo; inputs geometry: GeometryBase, userKey: String, userValue: String; same code as c_script
c_script_8 = CSharpScript(geometry=top_bread, userKey="part", userValue="bread")  # -> out, geo; inputs geometry: GeometryBase, userKey: String, userValue: String; same code as c_script
levels = GetInteger(floors, AtLeast=1, AtMost=1, Maximum=2147483647, Minimum=1, TreeAccess=False)
filter = StreamFilter(Gate=cheese_2, Stream1=cheese_height)
filter_2 = StreamFilter(Gate=lettuce_2, Stream1=c_script_3.geo)
filter_3 = StreamFilter(Gate=cheese_2, Stream1=c_script_2.geo)
filter_4 = StreamFilter(Gate=mustard_2, Stream1=c_script_4.geo)
filter_5 = StreamFilter(Gate=onion_2, Stream1=c_script_5.geo)
filter_6 = StreamFilter(Gate=ketchup_2, Stream1=c_script_6.geo)
filter_7 = StreamFilter(Gate=tomato_2, Stream1=c_script_7.geo)
addition = Addition(A=meet_height, B=filter)
merge = Merge(Data1=filter_3, Data2=filter_2, Data3=c_script.geo)  # -> flatten(Result)
merge_2 = Merge(Data1=filter_4, Data2=filter_5, Data3=filter_6, Data4=filter_7)
series = Series(Start=0, Step=addition, Count=levels)
vegetables_height = Slider(400, range=0..600)
tomato_height = Slider(105, range=0..600)
Z = UnitZ(Factor=series)
move = Move(Geometry=graft(merge), Motion=Z)  # -> Geometry, Transform
lng = ListLength(List=move.Geometry)
lng_2 = ListLength(List=flatten(lng))
series_2 = Series(Start=0, Step=1, Count=lng_2)
subtraction = Subtraction(A=levels, B=1)
filter_8 = StreamFilter(Gate=tomato_2, Stream0=tomato_height)
area = Area(Geometry=move.Geometry)  # -> Area, Centroid
random = Random(Range="0 to 360", Number=lng, Seed=graft(series_2))
multiplication = Multiplication(A=vegetables_height, B=subtraction)
subtraction_2 = Subtraction(A=multiplication, B=filter_8)
rotate = Rotate(Geometry=move.Geometry, Angle=degrees(random), Plane=area.Centroid)  # -> Geometry, Transform
Z_2 = UnitZ(Factor=subtraction_2)
move_2 = Move(Geometry=merge_2, Motion=Z_2)  # -> Geometry, Transform
bbox = BoundingBox(Content=flatten([move_2.Geometry, rotate.Geometry]), Plane=PlaneXY(0, 0, 0), UnionBox=True)  # -> Box, Box_2
debox = DeconstructBox(Box=bbox.Box)  # -> Plane, X, Y, Z
python = GhPythonScript(x=debox.Z)  # -> out, a
# ---------- python: Python ----------
a = x.Length
# ---------- end python ----------
subtraction_3 = Subtraction(A=python.a, B=Slider(150, range=0..200))
Z_3 = UnitZ(Factor=subtraction_3)
python_2 = GhPythonScript(geo=rotate.Geometry)  # -> out, cheese, lettuce, meat; inputs geo: tree of GeometryBase
# ---------- python_2: Python ----------
import Rhino.Geometry as rg

cheese =[]
lettuce = []
meat = []

for b in range(geo.BranchCount):
    for i in geo.Branch(b):
        if i.GetUserString("part") == "cheese":
            cheese.append(i)
        if i.GetUserString("part") == "lettuce":
            lettuce.append(i)
        if i.GetUserString("part") == "meat":
            meat.append(i)
# ---------- end python_2 ----------
python_3 = GhPythonScript(geo=move_2.Geometry)  # -> onion, tomato, ketchup, mustard; inputs geo: tree of GeometryBase
# ---------- python_3: Python ----------
import Rhino.Geometry as rg

onion  =[]
tomato = []
ketchup = []
mustard = []

for b in range(geo.BranchCount):
    for i in geo.Branch(b):
        if i.GetUserString("part") == "tomato":
            tomato.append(i)
        if i.GetUserString("part") == "onion":
            onion.append(i)
        if i.GetUserString("part") == "ketchup":
            ketchup.append(i)
        if i.GetUserString("part") == "mustard":
            mustard.append(i)
# ---------- end python_3 ----------
move_3 = Move(Geometry=c_script_8.geo, Motion=Z_3)  # -> Geometry, Transform
bottom_bread = Geometry(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)
c_script_9 = CSharpScript(geometry=bottom_bread, userKey="part", userValue="bread")  # -> out, geo; inputs geometry: GeometryBase, userKey: String, userValue: String; same code as c_script
top_bread_2 = Geometry(move_3.Geometry)
swatch = ColourSwatch(SwatchColor=RGB(255, 162, 0))
swatch_2 = ColourSwatch(SwatchColor=RGB(255, 245, 158))
swatch_3 = ColourSwatch(SwatchColor=RGB(170, 0, 255))
swatch_4 = ColourSwatch(SwatchColor=RGB(255, 255, 0))
swatch_5 = ColourSwatch(SwatchColor=RGB(85, 255, 0))
swatch_6 = ColourSwatch(SwatchColor=RGB(102, 7, 7))
swatch_7 = ColourSwatch(SwatchColor=RGB(255, 51, 0))
swatch_8 = ColourSwatch(SwatchColor=RGB(255, 0, 0))
preview = CustomPreview(Geometry=python_2.cheese, Material=swatch_2)
preview_2 = CustomPreview(Geometry=python_3.onion, Material=swatch_3)
preview_3 = CustomPreview(Geometry=python_3.mustard, Material=swatch_4)
preview_4 = CustomPreview(Geometry=[top_bread_2, c_script_9.geo], Material=swatch)
preview_5 = CustomPreview(Geometry=python_2.meat, Material=swatch_6)
preview_6 = CustomPreview(Geometry=python_3.tomato, Material=swatch_7)
preview_7 = CustomPreview(Geometry=python_3.ketchup, Material=swatch_8)
preview_8 = CustomPreview(Geometry=python_2.lettuce, Material=swatch_5)
mcol = MeshColours(Mesh=python_2.cheese, Colours=swatch_2)
mcol_2 = MeshColours(Mesh=python_2.meat, Colours=swatch_6)
mcol_3 = MeshColours(Mesh=python_2.lettuce, Colours=swatch_5)
mcol_4 = MeshColours(Mesh=[top_bread_2, c_script_9.geo], Colours=swatch)
mcol_5 = MeshColours(Mesh=python_3.mustard, Colours=swatch_4)
mcol_6 = MeshColours(Mesh=python_3.onion, Colours=swatch_3)
mcol_7 = MeshColours(Mesh=python_3.tomato, Colours=swatch_7)
mcol_8 = MeshColours(Mesh=python_3.ketchup, Colours=swatch_8)
merge_3 = Merge(Data1=mcol_4, Data2=mcol_5, Data3=mcol_6, Data4=mcol_8, Data5=mcol_7, Data6=mcol, Data7=mcol_3, Data8=mcol_2)  # -> flatten(Result)
number_slider = Slider(0.001, range=0..0.001)
number_slider_2 = Slider(0.1, range=0..0.1)
context_bake = ContextBake(Content=merge_3)
